# Grasshopper definition multiLayerArt.gh (Grasshopper 1.0.7)

# ---- group: Input curves
crv = Curve([<curve referenced from the Rhino model> x11])
cls = Closed(Curve=crv)  # -> Closed, Periodic
cull = CullPattern(List=crv, CullPattern=cls.Closed)
area = Area(Geometry=cull)  # -> Area, Centroid
sort = SortList(Keys=area.Area, ValuesA=cull)  # -> Keys, reverse(ValuesA)
larger = LargerThan(FirstNumber=sort.ValuesA, SecondNumber=Slider(10, range=0..2000))  # -> LargerThan, OrEqualTo
number_slider = Slider(0, range=0..100)
cull_2 = CullPattern(List=sort.ValuesA, CullPattern=larger.LargerThan)
shapes = CullIndex(List=cull_2, Indices=number_slider, Wrap=True)
frame = ListItem(List=cull_2, Index=number_slider, Wrap=True)
midpt = CurveMiddle(Curve=shapes)
points = PointList(Points=midpt, Size=Slider(10, range=0..10))

# ---- group: Generate cutouts
frame_thickness = Slider(20, range=0..20)
panel = Panel("""[
{"out": [4, 6, 3], "in": []}, 
{"out": [], "in": [0]}, 
{"out": [], "in": [1]}, 
{"out": [7, 5], "in": []}, 
{"out": [], "in": [2]}, 
{"out": [9], "in": []}, 
{"out": [8], "in": []}, 
]""")
bbox = BoundingBox(Content=frame, Plane=PlaneXY(0, 0, 0))  # -> Box, Box_2
bbox_2 = BoundingBox(Content=shapes, Plane=PlaneXY(0, 0, 0))  # -> Box, Box_2
offset = OffsetCurve(Curve=frame, Distance=frame_thickness, Corners=1)
boundary = BoundarySurfaces(Edges=frame)
debox = DeconstructBox(Box=bbox.Box)  # -> Plane, X, Y, Z
debox_2 = DeconstructBox(Box=bbox_2.Box)  # -> Plane, X, Y, Z
python = GhPythonScript(
    shapes=flatten(shapes),
    outerFrame=offset,
    innerFrame=boundary,
    x=debox.X,
    y=debox.Y,
    groups=panel,
    tabWidth=Slider(10, range=0..10),
    shapeX=flatten(debox_2.X),
    shapeY=flatten(debox_2.Y),
    needsCover="[4, 6, 3]")  # -> out, outlines, numLayer, tabCovers; inputs shapes: list, shapeX: list, shapeY: list
# ---------- python: Python ----------
"""Provides a scripting component.
    Inputs:
        shapes: list of curves in the image
        outerFrame: outer frame of the image (curve)
        innerFrame: inner frame of the image (srf)
        x: inner x dimension of the frame
        y: inner y dimension of the frame
        groups: list of lists specifying which shapes are in each layer, 
            the first in each of the inner list is the outermost shape of that layer
        tabWidth: width of the tabs connecting the shapes to the frame
        shapeX: list of x dimensions of the input shapes
        shapeY: list of y dimensions of the input shapes
        needsCover: index of shapes that needs have its tab covered
    Output:
        outlines: outlines for each layer """

__author__ = "xiwe7299"

import rhinoscriptsyntax as rs
from Rhino.Geometry import AreaMassProperties, Line, Brep
from ghpythonlib import treehelpers

def findCurveCentroid(guid):
    curve = rs.coercecurve(guid)
    return AreaMassProperties.Compute(curve).Centroid
    
def connectToClosestEdge(shape):
    edgeFrom = shape.closestEdge.From
    edgeTo = shape.closestEdge.To
    tabEdgeIntersectPtX = 0
    tabEdgeIntersectPtY = 0
    # edge is parallel to Y-axis 
    if edgeFrom[0] == edgeTo[0]:
        tab = rs.AddRectangle(rs.WorldXYPlane(), shape.distanceToClosestEdge, tabWidth)
        ToY = shape.centroid[1]
        ToX = (edgeFrom[0] + shape.centroid[0])/2
        tabEdgeIntersectPtY = shape.centroid[1]
        tabEdgeIntersectPtX = edgeFrom[0]
        tabShowing = max(shape.distanceToClosestEdge - shape.x/2, tabWidth)
    # edge is parallel to X-axis
    else: 
        tab = rs.AddRectangle(rs.WorldXYPlane(), tabWidth, shape.distanceToClosestEdge)
        ToX = shape.centroid[0]
        ToY = (edgeFrom[1] + shape.centroid[1])/2
        tabEdgeIntersectPtY = edgeFrom[1]
        tabEdgeIntersectPtX = shape.centroid[0]
        tabShowing = max(shape.distanceToClosestEdge - shape.y/2, tabWidth)
    translateVector = rs.VectorCreate((ToX, ToY, 0), findCurveCentroid(tab))
    movedTab = rs.CopyObject(tab, translateVector)

    return movedTab, tabShowing, (tabEdgeIntersectPtX, tabEdgeIntersectPtY, 0)
    
class ShapeInFrame:
    def __init__(self, guid, boundingX, boundingY, dimX, dimY):
        self.guid = guid
        self.curve = rs.coercecurve(guid)
        amp = AreaMassProperties.Compute(self.curve)
        self.centroid = amp.Centroid
        self.closestEdge = None 
        self.distanceToClosestEdge = 0
        self.frameX = boundingX
        self.frameY = boundingY
        self.x = dimX.Max - dimX.Min
        self.y = dimY.Max - dimY.Min
        self.frameEdges = [
            Line(self.frameX.Min, self.frameY.Min, 0, self.frameX.Max, self.frameY.Min, 0), 
            Line(self.frameX.Min, self.frameY.Max, 0, self.frameX.Max, self.frameY.Max, 0), 
            Line(self.frameX.Min, self.frameY.Min, 0, self.frameX.Min, self.frameY.Max, 0), 
            Line(self.frameX.Max, self.frameY.Min, 0, self.frameX.Max, self.frameY.Max, 0)
            ]
    
    # returns distance to the edge closest to the centroid of the shape and this edge
    def findClosestEdge(self):
        smallestDist = 1000000
        cloesetEdge = None
        for e in self.frameEdges:
            dist = e.DistanceTo(self.centroid, False)
            if smallestDist >= dist:
                smallestDist = dist
                cloesetEdge = e
        self.closestEdge = cloesetEdge 
        self.distanceToClosestEdge = smallestDist
        return (smallestDist, cloesetEdge)
        

outlinesList = []  
tabCovers = []  
g = eval(groups)
needsCover = eval(needsCover)

# each group represent a layer
for group in g:
    # outer shapes are the ones connected to the frame by tab
    outlinesInLayer = []
    for outerIndex in group["out"]:
        outerShape = ShapeInFrame(shapes[outerIndex], x, y, shapeX[outerIndex], shapeY[outerIndex])
        outerShape.findClosestEdge()
        tab = connectToClosestEdge(outerShape)
        srfs = rs.AddPlanarSrf([tab[0], outerShape.guid])
        if outerIndex in needsCover:
            tabCoverCenter = rs.AddPoint(tab[2])
            tabCovers.append(rs.AddCircle(tabCoverCenter, tab[1]))
        
        #union = rs.BooleanUnion(srfs)
        outlinesInLayer += srfs
    outlinesList.append(outlinesInLayer)
outlines = treehelpers.list_to_tree(outlinesList)
numLayer = len(g)
# ---------- end python ----------
spacer = Group(Objects=[frame, offset])

# ---- group: Generate cutouts / Cover
rdiff = RegionDifference(CurvesA=frame, CurvesB=python.tabCovers)
cover = Group(Objects=[rdiff, offset])

# ---- group: Generate cutouts / Cutout for each layer
layerindex = Slider(6, range=0..10)
mod = Modulus(A=layerindex, B=python.numLayer)
branch = TreeBranch(Tree=simplify(python.outlines), Path=mod, MaintainPaths=True)
innershapes = GhPythonScript(shapes=flatten(shapes), groups=panel, layer=mod)  # -> out, currentLayer; inputs shapes: list, layer: Int32
# ---------- innershapes: Python ----------
"""Provides a scripting component.
    Inputs:
        shapes: list of curves in the image
        groups: list of lists specifying which shapes are in each layer, 
            the first in each of the inner list is the outermost shape of that layer
        layer: index of the current layer
    Output:
        currentLayer: shapes for the current layer"""

__author__ = "xiwe7299"

import rhinoscriptsyntax as rs

currentLayer = []
g = eval(groups)
layerIndex = layer % len(g)

innerShapesInGroup = g[layerIndex]["in"]
currentLayer = [shapes[i] for i in innerShapesInGroup]

print(currentLayer)
# ---------- end innershapes ----------
rdiff_2 = RegionDifference(CurvesA=boundary, CurvesB=branch)
outershapes = GhPythonScript(x=rdiff_2, y=branch)  # -> out, a
# ---------- outershapes: Python ----------
__author__ = "xiwe7299"

import rhinoscriptsyntax as rs

if y != None: 
    a = x 
else:
    a = None
# ---------- end outershapes ----------

# ---- group: Generate cutouts / LayerOrderText
X = UnitX(Factor=expr("-x", frame_thickness))
pt = ConstructPoint(XCoordinate=0, YCoordinate=0, ZCoordinate=0)
move = Move(Geometry=pt, Motion=X)  # -> Geometry, Transform
boundary_2 = BoundarySurfaces(Edges=offset)
ln = Line(StartPoint=pt, EndPoint=move.Geometry)
textsrf = TextOnSurface(Text=mod, Font="Sans Bold:no Italic:no", Height=5, Depth=0, BaseLine=ln, BaseSurface=boundary_2)

# ---- group: Generate cutouts / Cutout for each layer (continued)
group = Group(Objects=[offset, innershapes.currentLayer, outershapes.a, textsrf])
